% Simulink data dictionary MotorControl.sldd
% references ADCRawToIab.sldd

Tsec = Simulink.Signal(DataType="fixdt(0,32,2^-22,0)", Min=0, Max=500, Unit="sec", InitialValue="0")
PWM_A_DT = Simulink.Signal(StorageClass="GetSet", HeaderFile="InterfaceBswApp.h", GetFunction="get_$N", SetFunction="set_$N", DataType="uint8", InitialValue="0")
PWM_B_DT = Simulink.Signal(StorageClass="GetSet", HeaderFile="InterfaceBswApp.h", GetFunction="get_$N", SetFunction="set_$N", DataType="uint8", InitialValue="0")
PWM_C_DT = Simulink.Signal(StorageClass="GetSet", HeaderFile="InterfaceBswApp.h", GetFunction="get_$N", SetFunction="set_$N", DataType="uint8", InitialValue="0")
Kp_Iab_EMFobs = Simulink.Parameter(0.255, DataType="fixdt(1,16,2^-8,0)")
Ki_Iab_EMFobs = Simulink.Parameter(1600, DataType="fixdt(0,16,2^-3,0)")